# Grasshopper definition WWR-optimization-final.gh (Grasshopper 1.0.7)
# plug-ins: Bifocals, MetaHopper

number_slider = Slider(30, range=0..40)  # disabled
point = Point(<point referenced from the Rhino model>)  # disabled
unit_z = UnitZ(Factor=number_slider)  # disabled
xy_plane = XYPlane(Origin=point)  # disabled
number_slider_2 = Slider(50, range=0..100)  # disabled
move = Move(Geometry=xy_plane, Motion=unit_z)  # -> Geometry, Transform; disabled
mesh_sphere = MeshSphere(Base=move.Geometry, Radius=10, UCount=number_slider_2, VCount=number_slider_2)  # disabled
triangulate = Triangulate(Mesh=mesh_sphere)  # -> Mesh, Count; disabled
# foliage density
number_slider_3 = Slider(0.15, range=0..1)  # disabled
deconstruct_mesh = DeconstructMesh(Mesh=triangulate.Mesh)  # -> Vertices, Faces, Colours, Normals; disabled
list_length = ListLength(List=deconstruct_mesh.Faces)  # disabled
multiplication = Multiplication(A=list_length, B=number_slider_3)  # disabled
series = Series(Start=0, Step=1, Count=list_length)  # disabled
random_reduce = RandomReduce(List=series, Reduction=multiplication, Seed=1)  # disabled
ghpython_script = PythonScript(x=series, y=random_reduce)  # -> a; inputs x: list, y: list; disabled
# ---------- ghpython_script: Python ----------
a = (i in y for i in x)
# ---------- end ghpython_script ----------
cull_faces = CullFaces(Mesh=triangulate.Mesh, Pattern=ghpython_script)  # disabled
colour_swatch = ColourSwatch(SwatchColor=RGB(51, 149, 66))  # disabled
custom_preview = CustomPreview(Geometry=cull_faces, Shader=colour_swatch)  # disabled

# ----
# site address:
panel = Panel("961 20th Ave")

# ----
# Weather Data
panel_2 = Panel("http://climate.onebuilding.org/WMO_Region_4_North_and_Central_America/USA_United_States_of_America/WA_Washington/USA_WA_Seattle-King.County.Intl.AP-Boeing.Field.727935_TMY3.zip")
downloadepw = LBDownloadWeather(weather_URL=panel_2)  # -> epw_file, stat_file, ddy_file; plug-in component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

# ----
# input geometry
# manually select back edge
# of existing dwelling:
box_input = Brep(<brep referenced from the Rhino model>)
index = Slider(0, range=0..30)
curve = Curve(<curve referenced from the Rhino model>)

height_ft = Panel("12")

# ----
# context
geometry_pipeline = GeometryPipeline(
    GroupByLayer=False,
    GroupByType=False,
    IncludeHidden=True,
    IncludeLocked=True,
    LayerFilter="context",
    NameFilter="*",
    SublayerFiltering=True,
    TypeFilter=1073741848)
data = Data(geometry_pipeline)

get_selected_objects = GetSelectedObjects(AllObjects_Object=annualloads)  # -> ComponentObjects, ParamObjects, OtherObjects
document_info = DocumentInfo(AutoUpdate=False, Recursive=Toggle(True))  # -> DocumentName, DocumentFilePath, Components, Params, _3rdPartyAssemblies
get_runtime_messages = GetRuntimeMessages(Objects=[get_selected_objects.ComponentObjects, get_selected_objects.ParamObjects])  # -> flatten(Errors), flatten(Warnings)
panel_3 = Panel(get_runtime_messages.Errors)
panel_4 = Panel(document_info._3rdPartyAssemblies)
panel_5 = Panel(get_runtime_messages.Warnings)
panel_6 = Panel(document_info.DocumentName)
panel_7 = Panel()
get_objects_of_same_type = GetObjectsOfSameType(Objects=panel_7)
set_panel_properties = SetPanelProperties(Panel=get_objects_of_same_type, Color=ColourSwatch(SwatchColor=RGB(255, 255, 255)))
set_group_properties = SetGroupProperties(Group="Grasshopper.Kernel.Types.GH_ObjectWrapper", Color=ColourSwatch(SwatchColor=RGBA(255, 255, 255, 152)))  # disabled

cluster = Cluster(C=curve, B=box_input, existing_dwelling_back_curve=index)  # -> i, i_2, i_3, i_4, i_5, i_6, i_7, i_8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

# ----
# massing
panel_8 = Panel("1_zonename")
panel_9 = Panel("2_zonename")
outsidecrvfromrhino = Curve(flatten([cluster.i_2, cluster.L_4, cluster.L, cluster.i_6]))
panel_10 = Panel("3_zonename")
panel_11 = Panel("4_zonename")
outsidecrvfromrhino_2 = Curve(flatten([cluster.i, cluster.L_3, cluster.L_4, cluster.i_5]))
outsidecrvfromrhino_3 = Curve(flatten([cluster.i_3, cluster.L, cluster.L_2, cluster.i_7]))
panel_12 = Panel("5_zonename")
adiabaticcrvfromrhino = Curve(flatten([cluster.i_5, cluster.i_6, cluster.i_7, cluster.i_8]))
outsidecrvfromrhino_4 = Curve(flatten([cluster.i_4, cluster.L_3, cluster.L_2, cluster.i_8]))

curve_2 = Curve([cluster.i, cluster.i_2, cluster.i_3, cluster.i_4])
simoutput = HBSimulationOutput()  # -> out, sim_output; plug-in component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
config = HBConfig()  # -> python_exe, py_lib_install, rad_install, os_install, ep_install, hb_os_gem, standards, asset_report, default_sim; plug-in component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
simcontrol = HBSimulationControl(
    do_zone_sizing=Toggle(True),
    do_system_sizing=Toggle(False),
    do_plant_sizing=Toggle(False),
    for_sizing_period=Toggle(False),
    for_run_period=Toggle(False))  # -> sim_control; plug-in component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
panel_13 = Panel(config.ep_install)
simpar = HBSimulationParameter(output=simoutput.sim_output, timestep=Slider(1, range=0..10), terrain="Suburbs", sim_control=simcontrol)  # -> sim_par; plug-in component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
boolean_toggle = BooleanToggle(False)
# Simulation Inputs
# Simulation Folder Name:
# Simulation Name:
# .sql Filepath:
panel_14 = Panel(panel)
time_stamp = GhPythonScript(name=panel_14)  # -> out, name
# ---------- time_stamp: Python ----------
__author__ = "tmendeze"

import rhinoscriptsyntax as rs
if run:
    import datetime
    time = datetime.datetime.now().strftime('%Y%m%d%H%M')
    name_ = '{}_{}'.format(name, time)
    print(name_)
else:
    name_=name
# ---------- end time_stamp ----------
csv_path = GhPythonScript(sim_name=time_stamp.name)  # -> out, sql_path
# ---------- csv_path: Python ----------
__author__ = "tmendeze"
__version__ = "2021.03.02"

import rhinoscriptsyntax as rs
import os
sql = os.path.join('OpenStudio','run','eplusout.sql')
sql_path = os.path.join(path, sim_name, sql)
# ---------- end csv_path ----------
panel_15 = Panel(csv_path.sql_path)

# ----
# Simulation Outputs
# Output Folder Name:
panel_16 = Panel("tomas_test")

# ----
# EUI total:
# EUI breakdown:
south_wwr = Slider(0.58, range=0..0.95)
north_wwr = Slider(0.16, range=0..0.95)
east_wwr = Slider(0.16, range=0..0.95)
west_wwr = Slider(0.32, range=0..0.95)
galapagos = Galapagos(fitness=eui, gene=[north_wwr, east_wwr, south_wwr, west_wwr])

# ----
# ADU EUI Analysis via EnergyPlus
cluster_2 = Cluster_3(
    C=outsidecrvfromrhino_2,
    C_3=outsidecrvfromrhino,
    C_4=outsidecrvfromrhino_3,
    C_5=outsidecrvfromrhino_4,
    C_2=adiabaticcrvfromrhino,
    factor=height_ft,
    curves=curve_2)
cluster_3 = Cluster_4(crv=[cluster.i, cluster.i_2, cluster.i_3, cluster.i_4])
cluster_4 = Cluster_5(crv=[cluster.i, cluster.i_2, cluster.i_3, cluster.i_4])
cluster_5 = Cluster_2()  # -> constr_set, y
applyprogram = HBApplyProgramType(rooms=flatten(cluster_4), program=cluster_3)  # -> report, rooms; plug-in component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
applyconstrset = HBApplyConstructionSet(rooms=applyprogram.rooms, constr_set=cluster_5.constr_set)  # -> rooms; plug-in component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
boolean_toggle_2 = BooleanToggle(False)
aperturesbyratio = HBAperturesByRatio(hb_objs=flatten(applyconstrset), ratio=[north_wwr, east_wwr, south_wwr, west_wwr])  # -> report, hb_objs; plug-in component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
shade = HBShade(geo=data)  # -> report, shades; plug-in component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
annualloads = HBAnnualLoads(
    rooms=aperturesbyratio.hb_objs,
    shades=shade.shades,
    epw_file=downloadepw.epw_file,
    timestep=Slider(1, range=0..10),
    run_bal=boolean_toggle_2,
    run=boolean_toggle_2)  # -> report, total_load, cooling, heating, lighting, equip, hot_water, balance; plug-in component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

# ----
# View Zones
allzones = Data(aperturesbyratio.hb_objs)
vizbytype = HBVisualizeByType(hb_objs=allzones)  # -> walls, interior_walls, roofs, ceilings, exterior_floors, interior_floors, air_walls, apertures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; plug-in component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

panel_17 = Panel(annualloads.total_load)
mass_addition = MassAddition(Input=annualloads.total_load)  # -> Result, PartialResults
model = HBModel(rooms=flatten(aperturesbyratio.hb_objs), shades=flatten(shade.shades))  # -> report, model; plug-in component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
modeltoosm = HBModelToOSM(
    model=model.model,
    epw_file=downloadepw.epw_file,
    sim_par=simpar,
    folder="C:\Users\papep\Documents\GitHub\597-GA-research\sim_output",
    write=boolean_toggle,
    run=boolean_toggle)  # -> report, jsons, osw, osm, idf, sql, zsz, rdd, html; plug-in component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
eui = HBEndUseIntensity(sql=modeltoosm.sql, ip=Toggle(True))  # -> eui, eui_end_use, end_uses, gross_floor; plug-in component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
panel_18 = Panel(eui.eui)

wall_r_value = Panel(cluster_5.y)
panel_19 = Panel(panel_18)

# ==== cluster Cluster
C = ClusterInput()
explode = Explode(Curve=C, Recursive=True)  # -> Segments, Vertices
B = ClusterInput()
item = ListItem(List=explode.Segments, Index=Slider(1, range=0..3), Wrap=True)
edges = BrepEdges(Brep=B)  # -> Naked, Interior, NonManifold
existing_dwelling_back_curve = ClusterInput()
item_2 = ListItem(List=explode.Segments, Index=Slider(0, range=0..3), Wrap=True)
item_3 = ListItem(List=explode.Segments, Index=Slider(2, range=0..3), Wrap=True)
item_4 = ListItem(List=explode.Segments, Index=Slider(3, range=0..3), Wrap=True)
item_5 = ListItem(List=edges.Interior, Index=existing_dwelling_back_curve, Wrap=True)
midpt = CurveMiddle(Curve=item_5)
midpt_2 = CurveMiddle(Curve=item_4)
X = UnitX(Factor=Slider(8, range=0..100))
X_2 = UnitX(Factor=Slider(20, range=0..100))  # -> expr("-x", UnitVector)
Y = UnitY(Factor=Slider(5, range=0..100))  # -> expr("-x", UnitVector)
Y_2 = UnitY(Factor=Slider(5, range=0..100))
move = Move(Geometry=item_4, Motion=X)  # -> Geometry, Transform
move_2 = Move(Geometry=item, Motion=X_2)  # -> Geometry, Transform
move_3 = Move(Geometry=item_2, Motion=Y_2)  # -> Geometry, Transform
move_4 = Move(Geometry=item_3, Motion=Y)  # -> Geometry, Transform
pdecon = Deconstruct(Point=midpt)  # -> XComponent, YComponent, ZComponent
pdecon_2 = Deconstruct(Point=midpt_2)  # -> XComponent, YComponent, ZComponent
pt = ConstructPoint(XCoordinate=pdecon.XComponent, YCoordinate=pdecon_2.YComponent, ZCoordinate=0)
ptuvcrvs = IntersectCurves(CU=[move_2.Geometry, move.Geometry], CV=[move_4.Geometry, move_3.Geometry])
dist = Distance(PointA=pt, PointB=midpt_2)
subtraction = Subtraction(A=dist, B=Slider(5, range=0..10))
X_3 = UnitX(Factor=subtraction)
item_6 = ListItem(List=flatten(ptuvcrvs), Index=Slider(3, range=0..4), Wrap=True)
item_7 = ListItem(List=flatten(ptuvcrvs), Index=Slider(0, range=0..4), Wrap=True)
move_5 = Move(Geometry=item_4, Motion=X_3)  # -> Geometry, Transform
end = EndPoints(Curve=move_5.Geometry)  # -> Start, End
pdecon_3 = Deconstruct(Point=end.Start)  # -> XComponent, YComponent, ZComponent
pdecon_4 = Deconstruct(Point=item_7)  # -> XComponent, YComponent, ZComponent
rec_2pt = Rectangle2Pt(Plane=PlaneXY(0, 0, 0), PointA=item_6, PointB=item_7, Radius=0)  # -> Rectangle, Length
pt_2 = ConstructPoint(XCoordinate=pdecon_3.XComponent, YCoordinate=pdecon_4.YComponent, ZCoordinate=0)
rec_2pt_2 = Rectangle2Pt(Plane=PlaneXY(0, 0, 0), PointA=pt_2, PointB=item_6, Radius=0)  # -> Rectangle, Length
crv = Curve(rec_2pt_2.Rectangle)
explode_2 = Explode(Curve=crv, Recursive=True)  # -> Segments, Vertices
item_8 = ListItem(List=explode_2.Segments, Index=Slider(1, range=0..1), Wrap=True)
len = Length(Curve=item_8)
division = Division(A=len, B=Slider(-3.333, range=-10..10))
offset = OffsetCurve(Curve=crv, Distance=division, Plane=PlaneXY(0, 0, 0), Corners=1)
explode_3 = Explode(Curve=offset, Recursive=True)  # -> Segments, Vertices
item_9 = ListItem(List=explode_2.Vertices, Index=Slider(0, range=0..100), Wrap=True)
item_10 = ListItem(List=explode_2.Vertices, Index=Slider(1, range=0..100), Wrap=True)
item_11 = ListItem(List=explode_2.Vertices, Index=Slider(2, range=0..100), Wrap=True)
item_12 = ListItem(List=explode_2.Vertices, Index=Slider(3, range=0..100), Wrap=True)
item_13 = ListItem(List=explode_3.Vertices, Index=Slider(0, range=0..100), Wrap=True)
item_14 = ListItem(List=explode_3.Vertices, Index=Slider(1, range=0..100), Wrap=True)
item_15 = ListItem(List=explode_3.Vertices, Index=Slider(2, range=0..100), Wrap=True)
item_16 = ListItem(List=explode_3.Vertices, Index=Slider(3, range=0..100), Wrap=True)
item_17 = ListItem(List=explode_2.Segments, Index=Slider(0, range=0..100), Wrap=True)
item_18 = ListItem(List=explode_2.Segments, Index=Slider(1, range=0..100), Wrap=True)
item_19 = ListItem(List=explode_2.Segments, Index=Slider(2, range=0..100), Wrap=True)
item_20 = ListItem(List=explode_2.Segments, Index=Slider(3, range=0..100), Wrap=True)
ln = Line(StartPoint=item_11, EndPoint=item_15)
ln_2 = Line(StartPoint=item_12, EndPoint=item_16)
item_21 = ListItem(List=explode_3.Segments, Index=Slider(0, range=0..100), Wrap=True)
item_22 = ListItem(List=explode_3.Segments, Index=Slider(1, range=0..100), Wrap=True)
ln_3 = Line(StartPoint=item_9, EndPoint=item_13)
ln_4 = Line(StartPoint=item_10, EndPoint=item_14)
item_23 = ListItem(List=explode_3.Segments, Index=Slider(2, range=0..100), Wrap=True)
item_24 = ListItem(List=explode_3.Segments, Index=Slider(3, range=0..100), Wrap=True)
i = ClusterOutput(item_17)
i_2 = ClusterOutput(item_18)
i_3 = ClusterOutput(item_19)
i_4 = ClusterOutput(item_20)
L = ClusterOutput(ln)
L_2 = ClusterOutput(ln_2)
L_3 = ClusterOutput(ln_3)
L_4 = ClusterOutput(ln_4)
i_5 = ClusterOutput(item_21)
i_6 = ClusterOutput(item_22)
i_7 = ClusterOutput(item_23)
i_8 = ClusterOutput(item_24)

# ==== cluster Cluster_2
r_per_in = Slider(4, range=0..10)
multiplication = Multiplication(A=r_per_in, InsulationThickness=Slider(1, range=0..1))
division = Division(A=multiplication, B=5.67826)
opaquematnomass = HBOpaqueMaterialNoMass(name="AirGap", r_value=Slider(1, range=0..1))  # -> flatten(mat); plug-in component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
opaquematnomass_2 = HBOpaqueMaterialNoMass(name="ContExtInsulation", r_value=division)  # -> mat; plug-in component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
opaquemat = HBOpaqueMaterial(
    name="2x6 wall framing",
    thickness=Slider(0.0889, range=0..0.1),
    conductivity=Slider(0.041, range=0..0.1),
    density=Slider(141.25, range=0..1000),
    spec_heat=Slider(2300, range=0..10000))  # -> mat; plug-in component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
opaquemat_2 = HBOpaqueMaterial(
    name="Gypsum Board",
    thickness=Slider(0.5, range=0..1),
    conductivity=Slider(0.16, range=0..1),
    density=Slider(800, range=0..1000),
    spec_heat=Slider(109, range=0..1000))  # -> mat; plug-in component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
opaquemat_3 = HBOpaqueMaterial(
    name="Wood Exterior Cladding",
    thickness=Slider(0.0191, range=0..0.1),
    conductivity=Slider(0.116, range=0..1),
    density=Slider(540, range=0..1000),
    spec_heat=Slider(1210, range=0..10000))  # -> flatten(mat); plug-in component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
clean = CleanTree(
    RemoveNulls=True,
    RemoveInvalid=True,
    RemoveEmpty=False,
    Tree=flatten([opaquemat_3, opaquematnomass, opaquematnomass_2, opaquemat, opaquemat_2]))
opaqueconstr = HBOpaqueConstruction(name="ExteriorWall", materials=clean)  # -> constr; plug-in component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
decnstrconstr = HBDeconstructConstruction(constr=opaqueconstr)  # -> materials, layers, r_val_si, r_val_ip, u_fac_si, u_fac_ip, t_sol, t_vis; plug-in component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
panel = Panel(clean)
one_over_x = OneOverX(Value=decnstrconstr.u_fac_ip)
r_value_of_wall_construction = Panel(one_over_x)
constructiontypes = HBConstructionTypes({"SteelFramed", "WoodFramed", "Mass", "Metal Building"}, selected="WoodFramed")
climatezones = HBClimateZones({"1 - Very Hot": "1", "2 - Hot": "2", "3 - Warm": "3", "4 - Mixed": "4", "5 - Cool": "5", "6 - Cold": "6", "7 - Very Cold": "7", "8 - Subarctic": "8"}, selected="4 - Mixed")
y = ClusterOutput(one_over_x)
constrsetclimate = HBConstructionSetByClimate(climate_zone=climatezones, constr_type=constructiontypes)  # -> constr_set; plug-in component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
list = ItemSelector(constrsetclimate, {"2013::ClimateZone4::WoodFramed"}, selected="2013::ClimateZone4::WoodFramed")
windowmat = HBWindowMaterial(name="ADU_Glazing", u_factor=flatten(".40"), shgc=flatten(".40"), t_vis=flatten(".63"))  # -> mat; plug-in component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
windowconstr = HBWindowConstruction(name="ADU_Glazing", materials=flatten(windowmat))  # -> constr; plug-in component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
decnstrconstrset = HBDeconstructConstructionSet(constr_set=list)  # -> exterior_wall, exterior_roof, exposed_floor, ground_wall, ground_roof, ground_floor, window, skylight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; plug-in component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
panel_2 = Panel(decnstrconstrset.exterior_roof)
exteriorsubset = HBExteriorConstructionSubset(exterior_wall=opaqueconstr, exterior_roof=decnstrconstrset.exterior_roof, exposed_floor=decnstrconstrset.exposed_floor)  # -> exterior_set; plug-in component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
groundsubset = HBGroundConstructionSubset(
    ground_wall=decnstrconstrset.ground_wall,
    ground_roof=decnstrconstrset.ground_roof,
    ground_floor=decnstrconstrset.ground_floor)  # -> ground_set; plug-in component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
subfacesubset = HBSubfaceSubset(window=windowconstr, skylight=windowconstr, operable=windowconstr, glass_door=windowconstr)  # -> subface_set; plug-in component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
constructionset = HBConstructionSet(
    name="CustomConstructionSet",
    base_constr_set=list,
    exterior_subset=exteriorsubset,
    ground_subset=groundsubset,
    subface_subset=subfacesubset)  # -> constr_set; plug-in component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
constr_set = ClusterOutput(constructionset)

# ==== cluster Cluster_3
factor = ClusterInput()
C = ClusterInput()
C_2 = ClusterInput()
C_3 = ClusterInput()
C_4 = ClusterInput()
C_5 = ClusterInput()
curves = ClusterInput()
join_curves = JoinCurves(Curves=curves, Preserve=False)

# ----
# Geometry
unit_z = UnitZ(Factor=factor)
join = JoinCurves(Curves=C, Preserve=False)
join_2 = JoinCurves(Curves=C_2, Preserve=False)
join_3 = JoinCurves(Curves=C_3, Preserve=False)
join_4 = JoinCurves(Curves=C_4, Preserve=False)
join_5 = JoinCurves(Curves=C_5, Preserve=False)
crv = Curve([join, join_3, join_4, join_5, join_2])
extrude = Extrude(Base=join_curves, Direction=unit_z)
cap_holes = CapHoles(Brep=extrude)
roomsolid = HBRoomFromSolid(geo=flatten(cap_holes), conditioned=True)  # -> report, rooms; plug-in component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
solveadj = HBSolveAdjacency(rooms=flatten(roomsolid.rooms), air_boundary=Toggle(True), run=Toggle(True))  # -> report, adj_rooms; plug-in component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

adj_rooms = ClusterOutput(solveadj.adj_rooms)

# ==== cluster Cluster_4
hb_building_programs = HBBuildingPrograms({"LargeOffice", "MediumOffice", "SmallOffice", "MidriseApartment", "HighriseApartment", "Retail", "StripMall", "PrimarySchool", "SecondarySchool", "SmallHotel", "LargeHotel", "Hospital", "Outpatient", "Laboratory", "Warehouse", "SuperMarket", "FullServiceRestaurant", "QuickServiceRestaurant", "Courthouse", "LargeDataCenterHighITE", "LargeDataCenterLowITE", "SmallDataCenterHighITE", "SmallDataCenterLowITE"}, selected="MidriseApartment")
searchprog = HBSearchPrograms(bldg_prog=hb_building_programs)  # -> room_prog; plug-in component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
item_selector = ItemSelector(
    searchprog,
    {"2013::MidriseApartment::Apartment", "2013::MidriseApartment::Corridor", "2013::MidriseApartment::Office"}, selected="2013::MidriseApartment::Apartment")
crv = ClusterInput()
crv_2 = Curve(crv)
deconstrprogram = HBDeconstructProgramType(program=item_selector)  # -> people, lighting, electric_equip, gas_equip, hot_water, infiltration, ventilation, setpoint; plug-in component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
join = JoinCurves(Curves=crv_2, Preserve=False)
area = Area(Geometry=join)  # -> Area, Centroid
decnstrpeople = HBDeconstructPeople(people=deconstrprogram.people)  # -> name, ppl_per_area, occupancy_sch, activity_sch; plug-in component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
decnstrequipment = HBDeconstructEquipment(equip=deconstrprogram.electric_equip)  # -> name, watts_per_area, schedule, radiant_fract, latent_fract, lost_fract, is_gas; plug-in component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
division = Division(A=area.Area, B="10.764")
division_2 = Division(A=Slider(2, range=0..10), B=division)
equipment = HBEquipment(
    name="ADU_Plug Load",
    watts_per_area="5.278592375366569",
    schedule=decnstrequipment.schedule,
    radiant_fract=decnstrequipment.radiant_fract,
    latent_fract=decnstrequipment.latent_fract,
    lost_fract=decnstrequipment.lost_fract,
    gas=Toggle(False))  # -> equip; plug-in component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
people = HBPeople(
    name="ADU_People",
    ppl_per_area=division_2,
    occupancy_sch=decnstrpeople.occupancy_sch,
    activity_sch=decnstrpeople.activity_sch)  # -> people; plug-in component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
programtype = HBProgramType(
    name="ADU",
    people=people,
    lighting=deconstrprogram.lighting,
    electric_equip=equipment,
    gas_equip=deconstrprogram.gas_equip,
    hot_water=deconstrprogram.hot_water,
    infiltration=deconstrprogram.infiltration,
    ventilation=deconstrprogram.ventilation,
    setpoint=deconstrprogram.setpoint)  # -> program; plug-in component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
item_selector_2 = ClusterOutput(item_selector)

# ==== cluster Cluster_5
crv = ClusterInput()
crv_2 = Curve(crv)
join = JoinCurves(Curves=crv_2, Preserve=False)
Z = UnitZ(Factor=Slider(10, range=0..10))
extr = Extrude(Base=join, Direction=Z)
cap = CapHoles(Brep=extr)
roomsolid = HBRoomFromSolid(geo=flatten(cap), conditioned=True)  # -> report, rooms; plug-in component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
rooms = ClusterOutput(roomsolid.rooms)
