# Grasshopper definition ladybug_v1.0.gh (Grasshopper 1.0.7)
# plug-ins: Bifocals

panel = Panel("http://climate.onebuilding.org/WMO_Region_4_North_and_Central_America/USA_United_States_of_America/WA_Washington/USA_WA_Seattle-Tacoma.Intl.AP.727930_TMY3.zip")
run_rad_sim = BooleanToggle(False)
galapagos = Galapagos()
downloadepw = LBDownloadWeather(weather_URL=panel)  # -> epw_file, stat_file, ddy_file; plug-in component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
importepw = LBImportEPW(epw_file=downloadepw.epw_file)  # -> location, dry_bulb_temperature, dew_point_temperature, relative_humidity, wind_speed, wind_direction, direct_normal_rad, diffuse_horizontal_rad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; plug-in component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
buildingfootprint = DFBuildingFromFootprint()  # -> out, buildings; plug-in component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
skymatrix = LBCumulativeSkyMatrix(location=importepw.location, direct_rad=importepw.direct_normal_rad, diffuse_rad=importepw.diffuse_horizontal_rad)  # -> out, sky_mtx; plug-in component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
incidentradiation = LBIncidentRadiation(sky_mtx=skymatrix.sky_mtx, run=run_rad_sim)  # -> out, points, results, total, mesh, legend, title, int_mtx; plug-in component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
panel_2 = Panel(incidentradiation.out)
